# Grasshopper definition IAU-COVID-SUPORTES-PF01.gh (Grasshopper 1.0.5)
# plug-ins: Pufferfish

# ---- group: altura do arco posterior
number_slider = Slider(14, range=0..20)

# ---- group: altura dos prendedores
number_slider_2 = Slider(8, range=0..20)

# ---- group: altura dos arcos intermediários
number_slider_3 = Slider(10, range=0..20)

# ---- group: altura do arco frontal
number_slider_4 = Slider(12, range=0..20)

# ---- group: dimensão dos conectores
number_slider_5 = Slider(-2.5, range=-2.5..2.5)
number_slider_6 = Slider(2.5, range=-2.5..2.5)

# ---- group: raio de curvatura dos cantos dos conectores
number_slider_7 = Slider(0.4, range=0..10)

# ----
apoios = Curve([<curve referenced from the Rhino model> x2])
base = Curve(<curve referenced from the Rhino model>)
hastes = Curve([<curve referenced from the Rhino model> x2])
unit_z = UnitZ(Factor=number_slider_3)
eixo_x_base_horizontal = Curve(<curve referenced from the Rhino model>)
eixo_y_base_vertical = Curve(<curve referenced from the Rhino model>)
frente = Curve(<curve referenced from the Rhino model>)
join_curves = JoinCurves(Curves=[base, hastes], Preserve=False)
length = Length(Curve=eixo_x_base_horizontal)
length_2 = Length(Curve=eixo_y_base_vertical)
unit_z_2 = UnitZ(Factor=number_slider_4)
prendedores = Curve(<curve referenced from the Rhino model>)
move = Move(Geometry=apoios, Motion=unit_z)  # -> Geometry, Transform
offset_curve = OffsetCurve(Curve=flatten(prendedores), Distance=Slider(2, range=0..10), Plane=PlaneXY(0, 0, 0), Corners=1)
curve = Curve([<curve referenced from the Rhino model> x4])
construct_domain = ConstructDomain(DomainStart=number_slider_5, DomainEnd=number_slider_6)
unit_z_3 = UnitZ(Factor=number_slider)
# Este modelo foi desenvolvido no
# Instituto de Arquitetura e Urbanismo da USP pelo pesquisador Rodrigo Scheeren, com o intuito de ser um modelo adaptado dos projetos de protetores faciais desenvolvidos até o momento, que pudesse ser modificado em seus parâmetros. O resultado é um modelo que mantém características de ergonomia, flexibilidade e conforto, utilizando menos material e otimizando o tempo de uso de uma impressora 3D.
# 
# Este projeto está licenciado com uma Licença Creative Commons [CC BY-NC 4.0 licença]
panel = Panel(length)
panel_2 = Panel(length_2)
move_2 = Move(Geometry=frente, Motion=unit_z_2)  # -> Geometry, Transform
list_item = ListItem(List=curve, Index=0, Wrap=True)  # -> Item, Item1, Item2, Item3
curve_2 = Curve([apoios, move.Geometry])
region_difference = RegionDifference(CurvesA=prendedores, CurvesB=offset_curve)
move_3 = Move(Geometry=join_curves, Motion=unit_z_3)  # -> Geometry, Transform
rectangle = Rectangle(Plane=list_item.Item, XSize=construct_domain, YSize=construct_domain, Radius=number_slider_7)  # -> Rectangle, Length
rectangle_2 = Rectangle(Plane=list_item.Item1, XSize=construct_domain, YSize=construct_domain, Radius=number_slider_7)  # -> Rectangle, Length
rectangle_3 = Rectangle(Plane=list_item.Item2, XSize=construct_domain, YSize=construct_domain, Radius=number_slider_7)  # -> Rectangle, Length
rectangle_4 = Rectangle(Plane=list_item.Item3, XSize=construct_domain, YSize=construct_domain, Radius=number_slider_7)  # -> Rectangle, Length
boundary_surfaces = BoundarySurfaces(Edges=region_difference)
unit_z_4 = UnitZ(Factor=number_slider_2)
point = Point(Point(-19, -51, 0))
sweep1 = Sweep1(Rail=list_item.Item, Sections=rectangle.Rectangle, Miter=1)
sweep1_2 = Sweep1(Rail=list_item.Item1, Sections=rectangle_2.Rectangle, Miter=1)
sweep1_3 = Sweep1(Rail=list_item.Item2, Sections=rectangle_3.Rectangle, Miter=1)
sweep1_4 = Sweep1(Rail=list_item.Item3, Sections=rectangle_4.Rectangle, Miter=1)
join_curves_2 = JoinCurves(Curves=move_3.Geometry, Preserve=False)
curve_3 = Curve([frente, move_2.Geometry])
extrude = Extrude(Base=boundary_surfaces, Direction=unit_z_4)
offset_curve_2 = OffsetCurve(
    Curve=curve_2,
    Distance=Slider(1, range=0..10),
    Plane=PlaneXY(0, 0, 0),
    BothSides=Toggle(True),
    Kinks=Slider(1, range=0..3),
    CapType=Slider(1, range=0..3))
yz_plane = YZPlane(Origin=point)
cap_holes = CapHoles(Brep=sweep1)
cap_holes_2 = CapHoles(Brep=sweep1_2)
cap_holes_3 = CapHoles(Brep=sweep1_3)
cap_holes_4 = CapHoles(Brep=sweep1_4)
curve_4 = Curve([join_curves, join_curves_2])
mirror = Mirror(Geometry=extrude, Plane=yz_plane)  # -> Geometry, Transform
boundary_surfaces_2 = BoundarySurfaces(Edges=offset_curve_2)
list_item_2 = ListItem(List=flatten(offset_curve_2), Index=0, Wrap=True)  # -> Item, Item1, Item2, Item3
offset_curve_3 = OffsetCurve(
    Curve=curve_3,
    Distance=Slider(1, range=0..10),
    Plane=PlaneXY(0, 0, 0),
    BothSides=Toggle(True),
    Kinks=Slider(2, range=0..3),
    CapType=Slider(3, range=0..3))
loft_options = LoftOptions(Closed=False, Adjust=False, Rebuild=Slider(2, range=0..10), Refit=0, Type=0)
loft = Loft(
    Curves=flatten([list_item_2.Item, list_item_2.Item2]),
    Options={Adjust=False, Closed=False, LoftEnds=0, LoftSimp=0, LoftType=0, Rebuild=10, Refit=0.01})
loft_2 = Loft(
    Curves=flatten([list_item_2.Item1, list_item_2.Item3]),
    Options={Adjust=False, Closed=False, LoftEnds=0, LoftSimp=0, LoftType=0, Rebuild=10, Refit=0.01})
offset_curve_4 = OffsetCurve(
    Curve=curve_4,
    Distance=Slider(1, range=0..10),
    Plane=PlaneXY(0, 0, 0),
    BothSides=Toggle(True),
    Kinks=Slider(0, range=0..3),
    CapType=Slider(3, range=0..3))
boundary_surfaces_3 = BoundarySurfaces(Edges=offset_curve_3)
loft_3 = Loft(Curves=flatten(offset_curve_3), Options=loft_options)
loft_4 = Loft(
    Curves=flatten(offset_curve_4),
    Options={Adjust=False, Closed=False, LoftEnds=0, LoftSimp=0, LoftType=0, Rebuild=10, Refit=0.01})
boundary_surfaces_4 = BoundarySurfaces(Edges=offset_curve_4)
brep_join = BrepJoin(Breps=flatten([boundary_surfaces_4, loft_4]))  # -> Breps, Closed
brep_join_2 = BrepJoin(Breps=flatten([extrude, mirror.Geometry]))  # -> Breps, Closed
brep_join_3 = BrepJoin(Breps=flatten([boundary_surfaces_2, loft, loft_2]))  # -> Breps, Closed
brep_join_4 = BrepJoin(Breps=flatten([boundary_surfaces_3, loft_3]))  # -> Breps, Closed
brep_join_5 = BrepJoin(Breps=flatten([cap_holes, cap_holes_2, cap_holes_3, cap_holes_4]))  # -> Breps, Closed
brep_join_6 = BrepJoin(Breps=flatten([brep_join.Breps, brep_join_2.Breps, brep_join_3.Breps, brep_join_4.Breps, brep_join_5.Breps]))  # -> Breps, Closed
